# Grasshopper definition 16042023_UPDATED_getCvsIc.gh (Grasshopper 1.0.7)
# plug-ins: SectionTools

X = UnitX(Factor=1)
pi = Pi(Factor=1)

geo = Geometry([<brep referenced from the Rhino model> x3])
secprops = SectionProperties(Sections=geo)  # -> Area, Centroid, Moments
Y = UnitY(Factor=1)
rot3d = Rotate3D(Geometry=geo, Angle=1.570796327, Center=secprops.Centroid, Axis=X)  # -> Geometry, Transform
pt = ConstructPoint(XCoordinate=0, YCoordinate=0, ZCoordinate=0)
# From Section 2 of the paper,
# it shows that the transformed moment of inertia does not include the post tension wire ropes.
rotate = Rotate(Geometry=rot3d.Geometry, Angle=pi, Plane=secprops.Centroid)  # -> Geometry, Transform
vec2pt = Vector2Pt(PointA=secprops.Centroid, PointB=pt, Unitize=False)  # -> Vector, Length
# Input geometry of the pixel section
move = Move(Geometry=rotate.Geometry, Motion=vec2pt.Vector)  # -> Geometry, Transform

number_slider = Slider(5, range=0..10)
number_slider_2 = Slider(10, range=0..10)
pt_2 = ConstructPoint(XCoordinate=number_slider, YCoordinate=number_slider_2, ZCoordinate=0)
expression = Expression(b=number_slider, h=number_slider_2, Expression="b*h^3/12")
expression_2 = Expression(b=number_slider_2, h=number_slider, Expression="b*h^3/12")
rec_2pt = Rectangle2Pt(Plane=PlaneXY(0, 0, 0), PointA=Point(0, 0, 0), PointB=pt_2, Radius=0)  # -> Rectangle, Length
iy = Panel(expression_2)
ix = Panel(expression)

geo_2 = Geometry(move.Geometry)
explode = Explode(Curve=geo_2, Recursive=True)  # -> Segments, flatten(Vertices)
pdecon = Deconstruct(Point=explode.Vertices)  # -> XComponent, YComponent, ZComponent
number_slider_3 = Slider(148, range=0..300)
sort = SortList(Keys=pdecon.XComponent, ValuesA=explode.Vertices)  # -> Keys, ValuesA
sort_2 = SortList(Keys=pdecon.YComponent, ValuesA=explode.Vertices)  # -> Keys, ValuesA
item = ListItem(List=sort_2.ValuesA, Index=0, Wrap=True)  # -> Item1, Item
item_2 = ListItem(List=sort.ValuesA, Index=0, Wrap=True)
series = Series(Start=Slider(1, range=0..1), Step=1, Count=Slider(330, range=0..1000))
pdecon_2 = Deconstruct(Point=item.Item1)  # -> XComponent, YComponent, ZComponent
pdecon_3 = Deconstruct(Point=item_2)  # -> XComponent, YComponent, ZComponent
num = Number(series)
subtraction = Subtraction(A=pdecon_2.YComponent, B=num)
pt_3 = ConstructPoint(XCoordinate=expr("-x", pdecon_3.XComponent), YCoordinate=pdecon_2.YComponent, ZCoordinate=pdecon_2.ZComponent)
pt_4 = ConstructPoint(XCoordinate=pdecon_3.XComponent, YCoordinate=subtraction, ZCoordinate=pdecon_2.ZComponent)
rec_2pt_2 = Rectangle2Pt(Plane=PlaneXY(0, 0, 0), PointA=pt_4, PointB=pt_3, Radius=0)  # -> Rectangle, Length
boundary = BoundarySurfaces(Edges=graft(rec_2pt_2.Rectangle))
item_3 = ListItem(List=geo_2, Index=0, Wrap=True)  # -> Item, Item1, Item2
rint = RegionIntersection(CurvesA=boundary, CurvesB=item_3.Item)
rint_2 = RegionIntersection(CurvesA=boundary, CurvesB=item_3.Item1)
rint_3 = RegionIntersection(CurvesA=boundary, CurvesB=item_3.Item2)
cut_geo = Geometry([rint, rint_2, rint_3])
amoments = AreaMoments(Geometry=cut_geo)  # -> Area, Centroid, Inertia, InertiaError, Secondary, SecondaryError, Gyration
pdecon_4 = Deconstruct(Point=amoments.Inertia)  # -> XComponent, YComponent, ZComponent
pdecon_5 = Deconstruct(Point=amoments.Centroid)  # -> XComponent, YComponent, ZComponent
ma = MassAddition(Input=amoments.Area)  # -> Result, PartialResults
multiplication = Multiplication(A=amoments.Area, B=amoments.Centroid)
ma_2 = MassAddition(Input=multiplication)  # -> Result, PartialResults
y_pos = Number(pdecon_5.YComponent)
total_concrete_area_mm2 = Panel(ma.Result)
division = Division(A=ma_2.Result, B=ma.Result)
num_2 = Number(flatten(ma.Result))
pdecon_6 = Deconstruct(Point=division)  # -> XComponent, YComponent, ZComponent
subtraction_2 = Subtraction(A=pdecon_6.YComponent, B=y_pos)
sqr = Square(Value=subtraction_2)
multiplication_2 = Multiplication(A=sqr, B=amoments.Area)
addition = Addition(A=multiplication_2, B=pdecon_4.XComponent)
ma_3 = MassAddition(Input=addition)  # -> simplify(Result), PartialResults
num_3 = Number(flatten(ma_3.Result))
python = GhPythonScript(c=num, Area=num_2, Inertia=num_3, write=Button())  # -> out, data; inputs c: list, Area: list, Inertia: list
# ---------- python: Python ----------
__author__ = "pitipatw"
__version__ = "2023.04.16"

import csv
import rhinoscriptsyntax as rs

def CSVwrite():
    #Get the filename to create
    filter = "CSV File (*.csv)|*.csv|*.txt|All Files (*.*)|*.*||"
    filename = rs.SaveFileName("Save point coordinates as", filter)
    if( filename==None ): return
    
    data = len(c)*[0]
    for i in range(len(c)):
        data[i] = [c[i] , Area[i], Inertia[i]]
    with open(filename, "wb") as csvfile:
        csvwriter = csv.writer(csvfile,  delimiter=',')

        for row in data:
            csvwriter.writerow([row[0], row[1], row[2]])
        print "Data written sucessfully to file"
##########################################################################
# Check to see if this file is being executed as the "main" python
# script instead of being used as a module by some other python script
# This allows us to use the module which ever way we want.
if write:
    CSVwrite()
# ---------- end python ----------
panel = Panel(ma_3.Result)
graph = QuickGraph(num_3, SortOrder=0)
graph_2 = QuickGraph(num_2, SortOrder=0)
graph_3 = QuickGraph([num, num_2, num_3], SortOrder=0)
