# Grasshopper definition 20052023_UltimateStrengths.gh (Grasshopper 1.0.7)
# plug-ins: MetaHopper, SectionTools, Radical

# ---- group: Input these
# Fiber info.
# % of total PixelFrame section
# that will resist shear ( one side (2legs) ~ 1/3 -> 33%)
shear_area_ratio = Slider(0.4, range=0..1)
fr1 = Panel("2.95")
fr3 = Panel("1.34")

# ----
# Servicabiblity calculation
element_length_mm = Slider(3324, range=1..5000)
dead_load_n_mm2 = Slider(0.007, range=0..10)
live_load_n_mm2 = Slider(0.0048, range=0..10)
bay_depth_mm = Slider(2000, range=1..5000)
bay_depth = Number(bay_depth_mm)
length_l = Number(element_length_mm)
multiplication = Multiplication(A=dead_load_n_mm2, B=bay_depth)
multiplication_2 = Multiplication(A=live_load_n_mm2, B=bay_depth)
addition = Addition(A=multiplication, B=multiplication_2)
expression = Expression(w=addition, L=length_l, Expression="w*L^2/8")
expression_2 = Expression(w=multiplication, L=length_l, Expression="w*L^2/8")
I = Expression(Expression="5/384*w*L^4/E/I")  # disabled

# ----
# CROSS SECTION GEOMETRY
panel = Panel("""250
0.2
19
81.4""")

# ---- group: MATERIAL PROPERTIES
# MATERIAL PROPERTIES
concrete_compressive_yield_strength_f_c = Slider(57.8, range=20..100)  # "Concrete Compressive Yield Strength (f'c) (N/mm2)"
concrete_density_kg_m_3 = Slider(2400, range=0..10000)

# ---- group: Steel area, pick one
ps_steel_radius_mm = Slider(0, range=0..50)
total_area_mm2 = Slider(707, range=100..4000)

ps_steel_radius_mm_2 = Slider(16, range=0..50)
total_area_mm2_2 = Slider(100, range=100..4000)

# ----
eps_mpa = Slider(200000, range=0..1000000)

# ---- group: Input this
fpu_mpa = Slider(1725, range=0..2000)  # disabled
fpe_mpa = Slider(632.043, range=0..1300)

fpe_mpa_2 = Slider(119.753, range=0..1300)
fpu_mpa_2 = Slider(1725, range=0..2000)

# ----
# 3. OPTIMIZATION
panel_2 = Panel("fc': ")

# ----
# DESIGN PARAMETERS
width_of_arm_as_factor_of_l = Slider(0.2, range=0.2..0.5)
length_of_arm = Slider(300.6, range=200..400)
cover_length = Slider(30, range=30..150)
gap_width = Slider(20, range=10..40)

concat = Concatenate(FragmentC=panel_2, FragmentA=concrete_compressive_yield_strength_f_c, FragmentB=" MPa")
Z = UnitZ(Factor=expr("-x", length_l))
X = UnitX(Factor=bay_depth)
length_of_arm_mm = Number(length_of_arm)
origin_point_0_0_0 = Point(Point(0, 0, 0))
length_of_arm_mm_2 = Number(length_of_arm)
cover_length_mm = Number(cover_length)
gap_width_mm = Number(gap_width)
width_of_arm_as_factor_of_l_2 = Number(width_of_arm_as_factor_of_l)
length_of_arm_mm_3 = Number(length_of_arm_mm)
fc_mpa = Number(concrete_compressive_yield_strength_f_c)

# ---- group: MATERIAL PROPERTIES / ACI-08
expression_3 = Expression(fc=fc_mpa, Expression="4700*sqrt(fc)")

# ----
ec_mpa = Panel(expression_3)
ec_mpa_2 = Number(expression_3)
rho_c = Number(concrete_density_kg_m_3)
expression_4 = Expression(x=total_area_mm2, Expression="7700*x/1e9*753")
input = GhPythonScript(fc=concrete_compressive_yield_strength_f_c)  # -> out
# ---------- input: Python ----------
__author__ = "pitipatw"
__version__ = "2023.03.10"

import rhinoscriptsyntax as rs
import ghpythonlib.treehelpers as th
import json

# assign static values
output = dict() 
output["fc"] = fc

print(json.dumps(output))
# ---------- end input ----------

# ---- group: WebSockets for Julia
server_port = Panel("ws://127.0.0.1:2000/")
websocket_client_start = WebsocketClientStart(Address=server_port, InitalMessage=input, Reset=True)
websocket_client_receiver = WebsocketClientReceiver(WebsocketObjects=websocket_client_start, AutoUpdate=Toggle(True))  # -> Message, Status
panel_3 = Panel(websocket_client_receiver.Status)
panel_4 = Panel(websocket_client_receiver.Message)

# ----
panel_5 = Panel(websocket_client_receiver.Message)
panel_6 = Panel("ws://127.0.0.1:2000/")  # disabled
python = GhPythonScript()  # -> out, a; disabled; unedited script template
toggle = BooleanToggle(True)  # disabled

expression_5 = Expression(fc=fc_mpa, Expression="0.85-0.05*(fc-28)/7")
number = Number(0.85)
larger = LargerThan(FirstNumber=expression_5, SecondNumber=number)  # -> LargerThan, OrEqualTo
filter = StreamFilter(Gate=larger.OrEqualTo, Stream0=expression_5, Stream1=number)
number_2 = Number(0.65)
larger_2 = LargerThan(FirstNumber=expression_5, SecondNumber=number_2)  # -> LargerThan, OrEqualTo
filter_2 = StreamFilter(Gate=larger_2.OrEqualTo, Stream0=number_2, Stream1=filter)
beta = Panel(filter_2)

panel_7 = Panel("fc_prime")  # disabled
number_slider = Slider(90, range=0..100)
expression_6 = Expression(A=total_area_mm2, Expression="sqrt(A/2/pi)")
division = Division(A=length_of_arm, B=2)
vec = VectorXYZ(XComponent=division, YComponent=0, ZComponent=0)  # -> Vector, Length
vec_2 = VectorXYZ(XComponent=expr("-x", division), YComponent=0, ZComponent=0)  # -> Vector, Length

point = Point()  # disabled
point_2 = Point()  # disabled

expression_7 = Expression(fc=fc_mpa, Expression="0.17*sqrt(fc)")
fc_mpa_2 = Number(fc_mpa)
mdead_nmm = Number(expression_2)
mtotal_nmm = Number(expression)

pt = ConstructPoint(XCoordinate=Slider(-2663, range=-5000..4000), YCoordinate=Slider(-941, range=-5000..4000), ZCoordinate=0)
pt_2 = ConstructPoint(XCoordinate=Slider(-3321, range=-5000..4000), YCoordinate=Slider(-569, range=-5000..4000), ZCoordinate=0)
pt_3 = ConstructPoint(XCoordinate=Slider(-3330, range=-5000..4000), YCoordinate=Slider(-1376, range=-5000..4000), ZCoordinate=0)
pt_4 = ConstructPoint(XCoordinate=Slider(-3321, range=-5000..4000), YCoordinate=Slider(-569, range=-5000..4000), ZCoordinate=0)
pt_5 = ConstructPoint(XCoordinate=Slider(-3321, range=-5000..4000), YCoordinate=Slider(0, range=-5000..4000), ZCoordinate=0)
pt_6 = ConstructPoint(XCoordinate=Slider(-3321, range=-5000..4000), YCoordinate=Slider(-257, range=-5000..4000), ZCoordinate=0)

pt_7 = ConstructPoint(XCoordinate=Slider(-3321, range=-5000..4000), YCoordinate=Slider(329, range=-5000..4000), ZCoordinate=0)
pt_8 = ConstructPoint(XCoordinate=Slider(-1174, range=-5000..4000), YCoordinate=Slider(-719, range=-5000..4000), ZCoordinate=0)
tag = TextTag3D(Location=pt_7, Text=concat, Size=100, Justification=7)
onoff = EnableDisableObject(Enabled=False, AllObjects_Object=[image_2, image, expression_43, expression_44, expression_48, sin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])

e = Slider(0.51, range=0.3..1.2)

# ----
# Main reinforcement
# If you want total area instead, connect this to this
expression_8 = Expression(r=ps_steel_radius_mm, Expression="Format(\"{0:0.00}\",(pi*r^2))")
steel_area_mm2 = Number(total_area_mm2)
fpe = Number(fpe_mpa)
e_ratio = Number(e)

multiplication_3 = Multiplication(A=e_ratio, B=length_of_arm_mm)
division_2 = Division(A=fpe, B=eps_mpa)

# ---- group: ratio
division_3 = Division(A=fpe, B=fpu_mpa)  # disabled
fpe_fpu = Panel(division_3)  # disabled
panel_8 = Panel("Ratio: ")  # disabled
panel_9 = Panel("<0.5?")  # disabled
concat_2 = Concatenate(FragmentA=panel_8, FragmentB=fpe_fpu, FragmentC=panel_9)  # disabled
tag_2 = TextTag3D(
    Location=Plane(origin=(-1483, 1440, 0), x=(0.9996144207, -0.02776706724, 0), y=(0.02776706724, 0.9996144207, 0)),
    Text=concat_2,
    Size=100,
    Justification=7)  # disabled

# ----
# Note2: Maximum fy and fyt for shear reinforcement design = 420 MPa
# Note1: dp:Distancd from extreme compression fiber to controid of prestressing steel and
# not less than 0.8h
panel_10 = Panel("300")  # disabled
panel_11 = Panel("300")  # disabled
panel_12 = Panel("300")  # disabled
shear_steel_rein_area_mm2 = Number()  # disabled
s_inertia_mm4 = Number()  # disabled
pt_stress_mpa = Number()  # disabled
mmax_nmm = Number(panel_11)  # disabled
dp_mm = Number()  # disabled
mu_n_mm = Number()  # disabled
gamma_1 = Number(1)  # disabled
fpe_mpa_3 = Number(fpe)  # disabled
fpc_mpa = Number()  # disabled
fyt_mpa = Number()  # disabled
fc_mpa_3 = Number(fc_mpa)  # disabled
bw_mm = Number()  # disabled
fu_mpa = Number()  # disabled
fd_mpa = Number()  # disabled
vd_n = Number(panel_10)  # disabled
yt_mm = Number()  # disabled
pu_n = Number()  # disabled
vi_n = Number(panel_12)  # disabled
vp_n = Number()  # disabled
d_mm = Number()  # disabled
bwd = Multiplication(Bw=bw_mm, B=d_mm)  # disabled
vu_n = Number()  # disabled

# ---- group: pre-Calculation
expression_9 = Expression(f_c=fc_mpa_3, Gamma=gamma_1, Expression="Gamma*f_c^0.5")  # disabled
number_slider_2 = Slider(0.75, range=0..1)  # disabled
x = Multiplication(A=expression_9, B=number_slider_2)  # disabled
quickcheck = Panel(x)  # disabled

x_2 = Multiplication(A=expression_9, B=bwd)  # disabled
panel_13 = Panel(x_2)  # disabled

# ---- group: Vcw
vci = Expression(gf=expression_9, fpc=fpc_mpa, bw=bw_mm, dp=dp_mm, Vp=vp_n, Expression="(0.29*gf+0.3*fpc)*bw*dp + Vp")  # disabled
panel_14 = Panel(vci)  # disabled

# ---- group: Check
expression_10 = Expression(dp=dp_mm, Mu=mu_n_mm, Vu=vu_n, Expression="Vu*dp/Mu")  # disabled
panel_15 = Panel(expression_10)  # disabled
_1 = Integer(1)  # disabled
larger_3 = LargerThan(FirstNumber=expression_10, SecondNumber=_1)  # -> LargerThan, OrEqualTo; disabled
filter_3 = StreamFilter(Gate=larger_3.LargerThan, Stream0=expression_10, Stream1=_1)  # disabled
panel_16 = Panel(filter_3)  # disabled

# ----
image = ImageSampler(Filter="Colour", Interpolate=False, Umax=1, Umin=0, Vmax=1, Vmin=0, Wrap=1)  # disabled
image_2 = ImageSampler(Filter="Colour", Interpolate=False, Umax=1, Umin=0, Vmax=1, Vmin=0, Wrap=1)  # disabled
expression_11 = Expression(Gammasqfc=expression_9, Vd_m=filter_3, bwd=bwd, Expression="(0.05*Gammasqfc+4.8*Vd_m)*bwd")  # disabled
panel_17 = Panel(expression_11)  # disabled

panel_18 = Panel("0.14")  # disabled
x_3 = Multiplication(Gf=x_2, Coef=panel_18)  # disabled
panel_19 = Panel(x_3)  # disabled

panel_20 = Panel("0.42")  # disabled
x_4 = Multiplication(A=panel_20, B=x_2)  # disabled
panel_21 = Panel(x_4)  # disabled

panel_22 = Panel("0.17")  # disabled
x_5 = Multiplication(A=panel_22, B=x_2)  # disabled
panel_23 = Panel(x_5)  # disabled

larger_4 = LargerThan(FirstNumber=expression_11, SecondNumber=x_5)  # -> LargerThan, OrEqualTo; disabled
panel_24 = Panel("0")  # disabled
filter_4 = StreamFilter(Gate=larger_4.LargerThan, Stream0=panel_24, Stream1=expression_11)  # disabled
panel_25 = Panel(filter_4)  # disabled

wiredisplay = ControlWireDisplay(WireDisplay=1)  # disabled
mcre = Expression(I=s_inertia_mm4, gf=expression_9, yt=yt_mm, fpe=fpe_mpa_3, fd=fd_mpa, Expression="(I/yt)*(0.5*gf+fpe-fd)")  # disabled
larger_5 = LargerThan(FirstNumber=filter_4, SecondNumber=x_4)  # -> LargerThan, OrEqualTo; disabled

vci_2 = Expression(
    gf=expression_9,
    bw=bw_mm,
    dp=dp_mm,
    Vd=vd_n,
    Vi=vi_n,
    Mmax=mmax_nmm,
    Mcre=mcre,
    Expression="(0.05*gf*bw*dp + Vd+ Vi*Mcre/Mmax)")  # disabled
panel_26 = Panel(vci_2)  # disabled

min = Minimum(A=x_4, B=expression_11)  # disabled
panel_27 = Panel(min)  # disabled

larger_6 = LargerThan(FirstNumber=vci_2, SecondNumber=x_3)  # -> LargerThan, OrEqualTo; disabled
filter_5 = StreamFilter(Gate=larger_6.LargerThan, Stream0=vci_2, Stream1=x_3)  # disabled
vci_final = Panel(filter_5)  # disabled
larger_7 = LargerThan(FirstNumber=filter_5, SecondNumber=vci)  # -> LargerThan, OrEqualTo; disabled

filter_6 = StreamFilter(Gate=larger_7.LargerThan, Stream0=filter_5, Stream1=vci)  # disabled
vc_final2 = Panel(filter_6)  # disabled

filter_7 = StreamFilter(Gate=larger_5.OrEqualTo, Stream0=filter_4, Stream1=x_4)  # disabled
vc_final1 = Panel(filter_7)  # disabled

boolean_toggle = BooleanToggle(True)  # disabled
filter_8 = StreamFilter(Gate=boolean_toggle, Stream0=filter_6, Stream1=filter_7)  # disabled
number_3 = Number(0.75)  # disabled
x_6 = Multiplication(A=filter_8, B=number_3)  # disabled
phivc = Panel(x_6)  # disabled
subtraction = Subtraction(Vu=vu_n, PhiVc=x_6)  # disabled
vs_required = Panel(subtraction)  # disabled

expression_12 = Expression(Vu=vu_n, phiVc=x_6, Expression="Vu > 0.5*phiVc")  # disabled

panel_28 = Panel("Av min required")  # disabled
panel_29 = Panel("No Av min req")  # disabled
filter_9 = StreamFilter(Gate=expression_12, Stream0=panel_29, Stream1=panel_28)  # disabled
panel_30 = Panel(filter_9)  # disabled

# ----
# Secondary reinforcement (coming soon...)
expression_13 = Expression(r=ps_steel_radius_mm_2, Expression="Format(\"{0:0.00}\",(pi*r^2))")
steel_area_mm2_2 = Number(expression_13)
fpe_2 = Number(fpe_mpa_2)

e_2 = Slider(0.94, range=0..1.2)

e_ratio_2 = Number(e_2)
multiplication_4 = Multiplication(A=e_ratio_2, B=length_of_arm_mm)

Y = UnitY(Factor=expr("-x", multiplication_4))

# ---- group: Single L
Y_2 = UnitY(Factor=1)
# COMPOSITE Y LOOP 1 - VERSION A
arm_length = Number(expr("-x", length_of_arm_mm_3))
vec_3 = VectorXYZ(XComponent=expr("(sqrt(3)/2)*-x", Y_2), YComponent=expr("-1/2*x", Y_2), ZComponent=0)  # -> Vector, Length
line = LineSDL(Start=origin_point_0_0_0, Direction=Y_2, Length=arm_length)
line_2 = LineSDL(Start=origin_point_0_0_0, Direction=vec_3.Vector, Length=arm_length)
devec = DeconstructVector(Vector=vec_3.Vector)  # -> XComponent, YComponent, ZComponent
end = EndPoints(Curve=line)  # -> Start, End
end_2 = EndPoints(Curve=line_2)  # -> Start, End
vec_4 = VectorXYZ(XComponent=expr("-x", devec.YComponent), YComponent=devec.XComponent, ZComponent=devec.ZComponent)  # -> Vector, Length
multiplication_5 = Multiplication(A=length_of_arm_mm_3, B=width_of_arm_as_factor_of_l_2)
X_2 = UnitX(Factor=1)
line_3 = LineSDL(Start=end.End, Direction=X_2, Length=multiplication_5)
line_4 = LineSDL(Start=end_2.End, Direction=vec_4.Vector, Length=multiplication_5)
end_3 = EndPoints(Curve=line_4)  # -> Start, End
end_4 = EndPoints(Curve=line_3)  # -> Start, End

# ----
Y_3 = UnitY(Factor=1)
len = Length(Curve=line_4)
width_of_l_mm = Panel(len)
num = Number(expr("x*2", len))

# ---- group: Cover
line_5 = LineSDL(Start=end_4.End, Direction=expr("x", Y_3), Length=cover_length_mm)
line_6 = LineSDL(Start=end_3.End, Direction=expr("x", vec_3.Vector), Length=cover_length_mm)
end_5 = EndPoints(Curve=line_6)  # -> Start, End
end_6 = EndPoints(Curve=line_5)  # -> Start, End

# ---- group: Single L (continued)
arc = ArcSED(Start=end_5.End, End=end_6.End, Direction=vec_3.Vector)  # -> Arc, Plane, Radius
join = JoinCurves(Curves=[line_4, arc.Arc, line_3, line, line_2, line_5, line_6], Preserve=False)

# ---- group: MONITOR
# Dashboard
prestressed_steel_area_mm2 = Panel(steel_area_mm2)

# ----
multiplication_6 = Multiplication(A=prestressed_steel_area_mm2, B=fpe)

# ---- group: MONITOR (continued)
prestressed_force_n = Panel(multiplication_6)

initial_steel_strain = Panel(division_2)

# ----
# DESIGN OUTCOMES
arm_length_mm = Panel(length_of_arm_mm)
single_l_edge_thickness_mm = Panel(width_of_l_mm)

# ---- group: Composite Y
gap_width_2 = Number(gap_width_mm)
sqrt = SquareRoot(Value=3)
rotate = Rotate(Geometry=join, Angle=degrees(120), Plane=PlaneXY(0, 0, 0))  # -> Geometry, Transform
rotate_2 = Rotate(Geometry=join, Angle=degrees(240), Plane=PlaneXY(0, 0, 0))  # -> Geometry, Transform
division_4 = Division(A=gap_width_2, B=sqrt)
Y_4 = UnitY(Factor=division_4)
rotate_3 = Rotate(Geometry=Y_4, Angle=degrees(120), Plane=PlaneXY(0, 0, 0))  # -> Geometry, Transform
rotate_4 = Rotate(Geometry=Y_4, Angle=degrees(240), Plane=PlaneXY(0, 0, 0))  # -> Geometry, Transform

l_1 = Geometry(join)
l_2 = Geometry(rotate_2.Geometry)
l_3 = Geometry(rotate.Geometry)

# ----
addition_2 = Addition(A=num, B=gap_width_2)
width_of_y_arm_mm = Panel(addition_2)

# ---- group: Composite Y (continued)
move = Move(Geometry=l_1, Motion=rotate_4.Geometry)  # -> Geometry, Transform
move_2 = Move(Geometry=l_2, Motion=rotate_3.Geometry)  # -> Geometry, Transform
move_3 = Move(Geometry=l_3, Motion=Y_4)  # -> Geometry, Transform

# ----
composite_y = Geometry([move.Geometry, move_2.Geometry, move_3.Geometry])
geo = Geometry(composite_y)
extr = Extrude(Base=geo, Direction=Z)
move_4 = Move(Geometry=extr, Motion=X)  # -> Geometry, Transform
secprops = SectionProperties(Sections=geo)  # -> Area, Centroid, Moments
multiplication_7 = Multiplication(A=panel_5, B=secprops.Area)
expression_14 = Expression(x=multiplication_7, Expression="x*2400/1e6")
addition_3 = Addition(A=expression_14, B=expression_4)
move_5 = Move(Geometry=secprops.Centroid, Motion=Y)  # -> Geometry, Transform

# ----
# add fpe
rotate_5 = Rotate(Geometry=move_5.Geometry, Angle=-2.094395, Plane=PlaneXY(0, 0, 0))  # -> Geometry, Transform
rotate_6 = Rotate(Geometry=move_5.Geometry, Angle=2.094395102, Plane=PlaneXY(0, 0, 0))  # -> Geometry, Transform

panel_31 = Panel(addition_3)

# ---- group: Get cb and ct
explode = Explode(Curve=geo, Recursive=True)  # -> Segments, Vertices
pdecon = Deconstruct(Point=flatten(explode.Vertices))  # -> XComponent, YComponent, ZComponent
sort = SortList(Keys=pdecon.YComponent, ValuesA=flatten(explode.Vertices))  # -> Keys, ValuesA
item = ListItem(List=sort.Keys, Index=0, Wrap=True)  # -> Item1, Item
pdecon_2 = Deconstruct(Point=secprops.Centroid)  # -> XComponent, YComponent, ZComponent
subtraction_2 = Subtraction(A=item.Item1, B=pdecon_2.YComponent)
subtraction_3 = Subtraction(A=pdecon_2.YComponent, B=item.Item)
addition_4 = Addition(A=subtraction_2, B=subtraction_3)  # -> flatten(Result)
depth_of_the_section_mm = Panel(addition_4)

# ----
item_2 = ListItem(List=secprops.Moments, Index=0, Wrap=True)
moment_of_inertia_mm4 = Number(item_2)
panel_32 = Panel(moment_of_inertia_mm4)

# ---- group: local stress analysis
cb_mm = Number(subtraction_3)
ct_mm = Number(subtraction_2)

# ----
beam_cross_section_area_mm2 = Panel(secprops.Area)
beam_depth_m = Panel(addition_4)
width_of_y_arm_mm_2 = Panel(width_of_y_arm_mm)
moment_of_inertia_mm4_2 = Panel(moment_of_inertia_mm4)
multiplication_8 = Multiplication(A=beam_cross_section_area_mm2, B="1000", C="1e-9", D="2400")
panel_33 = Panel(multiplication_8)

expression_15 = Expression(w=addition, L=length_l, d=beam_depth_m, Expression="w*(L-d)/2/1000")
expression_16 = Expression(F=prestressed_force_n, A=beam_cross_section_area_mm2, E=ec_mpa_2, Expression="F/A/E")
expression_17 = Expression(Aps=prestressed_steel_area_mm2, Aconcrete=beam_cross_section_area_mm2, Expression="Aps/Aconcrete")
rho_p = Number(expression_17)

# ---- group: ACI 318M-19 Table:20.3.2.4.1 / valid for fpe< 0.5fpu
# Gonna be replaced by Julia
aci = Expression(fpe=fpe, fc=fc_mpa, rho=rho_p, Expression="fpe+70+fc/100/rho")

# ---- group: ACI 318M-19 Table:20.3.2.4.1
fpy_mpa_astm_a421 = Panel("1300")
aci_2 = Expression(fpe=fpe, Expression="fpe+420")
fpy = Number(fpy_mpa_astm_a421)
expression_18 = Expression(x=aci, y=aci_2, z=fpy, Expression="min(x,y,z)")

# ---- group: MONITOR (continued)
rho = Panel(rho_p)
fps_mpa = Panel(expression_18)

# ----
division_5 = Division(A=fps_mpa, B=eps_mpa)

# ---- group: MONITOR (continued)
final_steel_strain = Panel(division_5)
initial_concrete_strain = Panel(expression_16)

# ----
expression_19 = Expression(fc=fc_mpa, Aps=prestressed_steel_area_mm2, fps=fps_mpa, Expression="Aps*fps/(0.85*fc)")
panel_34 = Panel(expression_19)
cfroma = CompressionDepth(Sections=geo, TargetArea=panel_34, Tolerance="0.005", Plane=0, MaxIterations=100)  # -> Depth, Error
afromc = CompressionArea(Sections=geo, Depth=cfroma.Depth, Tolerance=0.001, Plane=0)  # -> Area, CompressionGeo
secprops_2 = SectionProperties(Sections=afromc.CompressionGeo)  # -> Area, Centroid, Moments

# ----
# FLEXURAL MOMENT ARM
# DISTANCE FROM BOTTOM TO STEEL
Y_5 = UnitY(Factor=expr("-x", multiplication_3))
move_6 = Move(Geometry=secprops.Centroid, Motion=Y_5)  # -> Geometry, Transform
vec2pt = Vector2Pt(PointA=move_6.Geometry, PointB=secprops_2.Centroid, Unitize=False)  # -> Vector, Length
devec_2 = DeconstructVector(Vector=vec2pt.Vector)  # -> XComponent, YComponent, ZComponent
flexural_moment_arm = Number(devec_2.YComponent)

compression_area_mm2 = Panel(afromc.Area)
flexure_moment_arm_mm = Panel(flexural_moment_arm)

# ---- group: eccentricity
vec2pt_2 = Vector2Pt(PointA=secprops.Centroid, PointB=move_6.Geometry, Unitize=False)  # -> Vector, Length
devec_3 = DeconstructVector(Vector=vec2pt_2.Vector)  # -> XComponent, YComponent, ZComponent
abs = Absolute(Value=devec_3.YComponent)

# ----
e_mm = Panel(abs)

e_mm_2 = Panel(abs)

python_2 = GhPythonScript(fc_prime=fc_mpa, rho_c=rho_c, PTsteel_r=ps_steel_radius_mm, PTsteel_area=steel_area_mm2, PTpos=e_mm)  # -> out, c; disabled
# ---------- python_2: Python ----------
__author__ = "pitipatw"
__version__ = "2023.01.24"

import rhinoscriptsyntax as rs
import json

temp = {'fc_prime': fc_prime ,\
'rho_c' : rho_c , 'PTsteel_r' : PTsteel_r ,\
'PTsteel_area' :PTsteel_area,\
'PTpos' : PTpos,\
'TEST_tuple' : (fc_prime, PTsteel_r)}

c = json.dumps(temp)
print(c)
# ---------- end python_2 ----------
websocket_client_start_2 = WebsocketClientStart(Address=panel_6, InitalMessage=python_2.c, Reset=Toggle(True))  # disabled
panel_35 = Panel(python_2.out)  # disabled
websocket_client_receiver_2 = WebsocketClientReceiver(WebsocketObjects=websocket_client_start_2, AutoUpdate=toggle)  # -> Message, Status; disabled
panel_36 = Panel(websocket_client_receiver_2.Message)  # disabled
panel_37 = Panel(websocket_client_receiver_2.Status)  # disabled
python_3 = GhPythonScript(x=panel_36, y=panel_7)  # -> out, c; disabled
# ---------- python_3: Python ----------
__author__ = "pitipatw"
__version__ = "2023.01.24"

import rhinoscriptsyntax as rs
import json

print(x)
temp1 = json.loads(x)
c = temp1[y]
# ---------- end python_3 ----------
panel_38 = Panel(python_3.out)  # disabled
panel_39 = Panel(python_3.c)  # disabled
move_7 = Move(Geometry=move_6.Geometry, Motion=vec.Vector)  # -> Geometry, Transform

compression_depth_a_mm = Panel(cfroma.Depth)
division_6 = Division(A=compression_depth_a_mm, Beta1=beta)
expression_20 = Expression(c=division_6, d=beam_depth_m, eci=initial_concrete_strain, Expression="(0.003+eci)*(d-c)/c")
multiplication_9 = Multiplication(A=expression_20, B=eps_mpa)

# ---- group: MONITOR
fps_from_aci = Panel(fps_mpa)
fps_from_s_s_relationship = Panel(multiplication_9)

# ----
move_8 = Move(Geometry=move_6.Geometry, Motion=vec_2.Vector)  # -> Geometry, Transform
circle = CircleCNR(Center=[move_7.Geometry, move_8.Geometry], Normal=Vector(0, 0, 1), Radius=expression_6)
num_2 = Number(final_steel_strain)
expression_21 = Expression(strain=num_2, Expression="if(strain > 0.005 , 0.9 , if(strain< 0.002, 0.65 , 0.65+0.25*(strain-0.002)/0.003))")
panel_40 = Panel(expression_21)

# ----
# Pure Axial Force
compression_area_mm2_2 = Number(beam_cross_section_area_mm2)
expression_22 = Expression(x=compression_area_mm2_2, Expression="Format(\"{0:0.00}\", x)")
compression = Expression(fc=fc_mpa, area=compression_area_mm2_2, Expression="0.85*fc*area")
panel_41 = Panel(expression_22)
compression_2 = Expression(Ccn=compression, fse=fpe, Ep=eps_mpa, Apt=prestressed_steel_area_mm2, Expression="(Ccn - (fse - 0.003*Ep)*Apt)/1000")
expression_23 = Expression(P=compression_2, Expression="0.65*0.8*P")
expression_24 = Expression(x=expression_23, Expression="Format(\"{0:0.00}\",x)")  # -> flatten(R)
concat_3 = Concatenate(FragmentA=Slider(0.8, range=0..1), FragmentB="x0.65xPn = ", FragmentC=expression_24, FragmentD=" kN")
tag_3 = TextTag3D(Location=pt_5, Text=concat_3, Size=100, Justification=7)

concrete_area_mm2 = Number(beam_cross_section_area_mm2)
prestressed_force_n_2 = Number(prestressed_force_n)
e_mm_3 = Number(e_mm)

# ----
# Check if breb is 3
# then it's ok
lng = ListLength(List=afromc.CompressionGeo)  # -> flatten(Length)
tag_4 = TextTag3D(Location=pt, Text=lng, Size=100, Justification=7)

division_7 = Division(A=flatten(compression_area_mm2), B=flatten(beam_cross_section_area_mm2))
concat_4 = Concatenate(FragmentA="Comp Area ratio: ", FragmentB=division_7)
panel_42 = Panel(lng)
panel_43 = Panel(division_7)
tag_5 = TextTag3D(Location=pt_3, Text=concat_4, Size=100, Justification=7)
ultimate_shear_n = Panel(expression_15)

total_concrete_area_mm2 = Number(beam_cross_section_area_mm2)
concrete_tensilte_str = Panel(expression_7)
multiplication_10 = Multiplication(Ac=total_concrete_area_mm2, Ratio=shear_area_ratio)
ned_axial_force_n = Number(prestressed_force_n)
fr3_2 = Number(fr3)
fr1_2 = Number(fr1)
expression_25 = Expression(Asl=prestressed_steel_area_mm2, A_shear=multiplication_10, Expression="Asl/A_shear")
multiplication_11 = Multiplication(Fc=fc_mpa_2, _02=0.2)
division_8 = Division(A=ned_axial_force_n, B=total_concrete_area_mm2)
expression_26 = Expression(d=beam_depth_m, Expression="1+sqrt(200/d)")
rho_2 = Number(expression_25)
larger_8 = LargerThan(FirstNumber=division_8, SecondNumber=multiplication_11)  # -> LargerThan, OrEqualTo
fctk = Number(concrete_tensilte_str)
filter_10 = StreamFilter(Gate=larger_8.OrEqualTo, Stream0=division_8, Stream1=multiplication_11)
multiplication_12 = Multiplication(A=fr1_2, B="0.45")
larger_9 = LargerThan(FirstNumber=expression_26, SecondNumber="2")  # -> LargerThan, OrEqualTo
sigma_cp = Number(filter_10)
expression_27 = Expression(fFts=multiplication_12, wu="1.5", CMOD3="1.5", fR3=fr3_2, fR1=fr1_2, Expression="fFts-wu/CMOD3*(fFts-0.5*fR3+0.2*fR1)")
filter_11 = StreamFilter(Gate=larger_9.LargerThan, Stream0=expression_26, Stream1="2")
expression_28 = Expression(
    gc="1",
    k=filter_11,
    rho=rho_2,
    fFtuk=expression_27,
    fctk=fctk,
    fck=fc_mpa_2,
    scp=sigma_cp,
    Expression="(0.18/gc*k*(100*rho*(1+7.5*fFtuk/fctk)*fck)^(1/3)+0.15*scp)/1000")
multiplication_13 = Multiplication(A=expression_28, B=multiplication_10)

multiplication_14 = Multiplication(A=multiplication_13, B="0.75")  # -> flatten(PhiV_kN)

expression_29 = Expression(x=multiplication_14, Expression="Format(\"{0:0.00}\",x)")
concat_5 = Concatenate(FragmentD="0.75", FragmentA="Vn =", FragmentB=expression_29, FragmentC="kN")
tag_6 = TextTag3D(Location=pt_4, Text=concat_5, Size=100, Justification=7)

concat_6 = Concatenate(FragmentD="Ultimate shear ", FragmentA=ultimate_shear_n, FragmentB=expression_29, FragmentC="kN")
tag_7 = TextTag3D(Location=pt_8, Text=concat_6, Size=100, Justification=7)

# ---- group: local stress analysis
dl = Number("7")
ll = Number("4.8")
expression_30 = Expression(top=[dl, ll], D=dl, L=ll, Expression="top/(D+L)")
expression_31 = Expression(fc=fc_mpa, Expression="0.25*sqrt(fc)")
expression_32 = Expression(fc=fc_mpa, Expression="-0.6*(fc)")
expression_33 = Expression(fc=fc_mpa, Expression="-0.6*(fc)")
division_9 = Division(A=moment_of_inertia_mm4_2, B=ct_mm)
division_10 = Division(A=moment_of_inertia_mm4_2, B=cb_mm)
item_3 = ListItem(List=expression_30, Index=0, Wrap=True)  # -> Item, Item1
expression_34 = Expression(density=rho_c, A=beam_cross_section_area_mm2, L=length_l, Expression="(density*A*L^2/8)/9.81/1e9")
self_moment_nmm = Panel(expression_34)
sb_mm3 = Number(division_10)
st_mm3 = Number(division_9)

# ----
panel_44 = Panel(division_9)

# ----
# RILEM TC 162-TDF (2003)
# ASTM C1609/C1609M
# fD_150 is equivalent to fe,3
# fe,3 is an indication of the total energy absorption (flex toughness) in a beam test.
# 
# fe,3 usually used for the design of FRC membes that are contimuously supported such as slabs-on-ground and shotcrete.
# 
# fD_150 is for FRC members without continuous support (beams, precast segments)
# 
# fD_150 can be slightly smaller than fe,3 which results in a more conservative design.
expression_35 = Expression(fD_150=fr3_2, S=st_mm3, Expression="fD_150*S/1e6")
multiplication_15 = Multiplication(_037=0.37)

# ---- group: local stress analysis / Transfer State , C- T+
expression_36 = Expression(
    Pi=prestressed_force_n_2,
    Ac=concrete_area_mm2,
    e=e_mm_3,
    St=st_mm3,
    Mdead=mdead_nmm,
    Expression="-Pi/Ac + Pi*e/St - Mdead/st")
expression_37 = Expression(
    Pi=prestressed_force_n_2,
    Ac=concrete_area_mm2,
    e=e_mm_3,
    Sb=sb_mm3,
    Mdead=mdead_nmm,
    Expression="-Pi/Ac - Pi*e/Sb + Mdead/Sb")

# ----
# Additional Flexture [kNm]
panel_45 = Panel(expression_35)

initial_state = Panel(expression_36)
limit_tension_transfer = Panel(expression_31)

initial_state_2 = Panel(expression_37)
limit_comp_transfer = Panel(expression_33)

division_11 = Division(A=initial_state_2, B=limit_comp_transfer)  # -> flatten(Result)
division_12 = Division(A=initial_state, B=limit_tension_transfer)  # -> flatten(Result)

# ----
# Moment
# Doubleclick Me!
expression_38 = Expression(Aps=prestressed_steel_area_mm2, fps=fps_mpa, arm=flexural_moment_arm, Expression="Aps*fps*arm/1e6")
mn_knm = Panel(expression_38)
phi = Number(expression_21)
multiplication_16 = Multiplication(A=mn_knm, B=phi)
expression_39 = Expression(x=multiplication_16, Expression="Format(\"{0:0.00}\",x)")  # -> flatten(R)
phi_mn_knm = Panel(expression_39)

expression_40 = Expression(x=phi, Expression="Format(\"{0:0.00}\",x)")

# ---- group: local stress analysis (continued)
multiplication_17 = Multiplication(A=phi_mn_knm, B="1e6/1.6*4/11")
addition_5 = Addition(A=expression_34, B=multiplication_17)

# ----
concat_7 = Concatenate(FragmentA=expression_40, FragmentD="Mn= ", FragmentB=phi_mn_knm, FragmentC=" kNm")
tag_8 = TextTag3D(Location=pt_6, Text=concat_7, Size=100, Justification=7)

# ---- group: local stress analysis / Service State
expression_41 = Expression(
    Pi=prestressed_force_n_2,
    Ac=concrete_area_mm2,
    e=e_mm_3,
    Sb=sb_mm3,
    Mt=addition_5,
    Expression="-Pi/Ac - Pi*e/Sb + Mt/Sb")  # disabled
expression_42 = Expression(
    Pi=prestressed_force_n_2,
    Ac=concrete_area_mm2,
    e=e_mm_3,
    St=st_mm3,
    Mt=mtotal_nmm,
    Expression="-Pi/Ac + Pi*e/St - Mt/st")

# ----
service_state = Panel(expression_42)
limit_comp_service = Panel(expression_32)

service_state_2 = Panel(expression_41)

larger_10 = LargerThan(FirstNumber=service_state, SecondNumber=limit_comp_service)  # -> LargerThan, OrEqualTo
larger_11 = LargerThan(FirstNumber=limit_tension_transfer, SecondNumber=initial_state)  # -> LargerThan, OrEqualTo
larger_12 = LargerThan(FirstNumber=initial_state_2, SecondNumber=limit_comp_transfer)  # -> LargerThan, OrEqualTo
multiplication_18 = Multiplication(A=larger_11.OrEqualTo, B=larger_12.OrEqualTo)
num_3 = Number(larger_10.OrEqualTo)
panel_46 = Panel(multiplication_18)
panel_47 = Panel(num_3)

division_13 = Division(A=service_state, B=limit_comp_service)  # -> flatten(Result)

# ----
# Results
pure_axial_kn = Panel(expression_24)
moment_knm = Panel(phi_mn_knm)
fiber_shear_capacity_kn = Panel(multiplication_14)

# ----
# Must be in [0,1]
panel_48 = Panel(division_11)
panel_49 = Panel(division_13)
_1_2 = Panel(division_12)

radical = Radical(
    Objective=addition_3,
    Constraints=[moment_knm, _1_2, panel_48, panel_49],
    NumericalVariables=[concrete_compressive_yield_strength_f_c, total_area_mm2, fpe_mpa, e, length_of_arm])  # -> ObjectiveEvolution, Var, GradientEvolution
num_4 = Number([pure_axial_kn, moment_knm, fiber_shear_capacity_kn, _1_2, panel_48, panel_49, panel_42, panel_43])
panel_50 = Panel(num_4)

# ---- group: ACI conservative check
larger_13 = LargerThan(FirstNumber=multiplication_9, SecondNumber=fps_from_aci)  # -> LargerThan, OrEqualTo; disabled
panel_51 = Panel("NO")  # disabled
panel_52 = Panel("YES")  # disabled
filter_12 = StreamFilter(Gate=larger_13.OrEqualTo, Stream0=panel_51, Stream1=panel_52)  # disabled

# ----
panel_53 = Panel("Conserved?:")  # disabled
concat_8 = Concatenate(FragmentA=panel_53, FragmentB=filter_12)  # disabled

# ---- group: ACI conservative check (continued)
tag_9 = TextTag3D(Location=PlaneXY(-1453, 1225, 0), Text=concat_8, Size=100, Justification=7)  # disabled

# ----
wiredisplay_2 = ControlWireDisplay(WireDisplay=1)  # disabled
panel_54 = Panel("""1
2
3
4""")  # disabled
item_4 = ListItem(List=panel_54, Index=0, Wrap=True)  # -> Item, Item1, Item2, Item3, Item4; disabled
angle_rad = Number(item_4.Item1)  # disabled
fpu_mpa_3 = Number(item_4.Item3)  # disabled
aps_mm2 = Number(item_4.Item2)  # disabled
s_mm = Number(item_4.Item)  # disabled
expression_43 = Expression(bw=bw_mm, s=s_mm, fyt=fyt_mpa, Expression="bw*s/fyt")  # disabled
expression_44 = Expression(Aps=aps_mm2, fpu=fpu_mpa_3, s=s_mm, fyt=fyt_mpa, bw=bw_mm, d=d_mm, Expression="Aps*fpu*s/(80*fyt*(bw*d)^0.5)")  # disabled
expression_45 = Expression(fc=fc_mpa_3, bwd=bwd, Expression="0.66*fc^0.5*bwd")  # disabled
expression_46 = Expression(fc=fc_mpa_3, bwd=bwd, Expression="0.25*fc^0.5*bwd")  # disabled
panel_55 = Panel("0.35")  # disabled
panel_56 = Panel(expression_45)  # disabled
panel_57 = Panel(expression_46)  # disabled
multiplication_19 = Multiplication(A=expression_43, B=panel_55)  # disabled
panel_58 = Panel(multiplication_19)  # disabled
panel_59 = Panel(expression_44)  # disabled
panel_60 = Panel("0")  # disabled
panel_61 = Panel("0")  # disabled

sin = Sine(Value=angle_rad)  # disabled
panel_62 = Panel(sin)  # disabled

expression_47 = Expression(fc=fc_mpa_3, bws_fyt=expression_43, Expression="0.062*fc^0.5*bws_fyt")  # disabled
panel_63 = Panel(expression_47)  # disabled

expression_48 = Expression(A_v=shear_steel_rein_area_mm2, f_y=fyt_mpa, sina=sin, Expression="A_v*f_y*sina")  # disabled
panel_64 = Panel(expression_48)  # disabled
larger_14 = LargerThan(FirstNumber=expression_48, SecondNumber=expression_46)  # -> LargerThan, OrEqualTo; disabled
filter_13 = StreamFilter(Gate=larger_14.LargerThan, Stream0=expression_48, Stream1=expression_46)  # disabled
panel_65 = Panel(filter_13)  # disabled
av_min_1 = Maximum(A=expression_47, B=multiplication_19)  # disabled
av_min_final = Minimum(A=av_min_1, B=expression_44)  # disabled
filter_14 = StreamFilter(Gate=expression_12, Stream0=panel_60, Stream1=av_min_final)  # disabled
larger_15 = LargerThan(FirstNumber=filter_13, SecondNumber=filter_14)  # -> LargerThan, OrEqualTo; disabled
min_av = Number(filter_14)  # disabled
panel_66 = Panel(filter_14)  # disabled
filter_15 = StreamFilter(Gate=larger_15.OrEqualTo, Stream1=filter_13)  # disabled
subtraction_4 = Subtraction(A=filter_15, B=subtraction)  # disabled
excess_shear_rein = Panel(subtraction_4)  # disabled
larger_16 = LargerThan(FirstNumber=excess_shear_rein, SecondNumber=panel_61)  # -> LargerThan, OrEqualTo; disabled

panel_67 = Panel("PASS MIN")  # disabled
panel_68 = Panel("NOT PASS")  # disabled
filter_16 = StreamFilter(Gate=larger_15.OrEqualTo, Stream0=panel_68, Stream1=panel_67)  # disabled

panel_69 = Panel([filter_16, filter_15])  # disabled

panel_70 = Panel(larger_16.OrEqualTo)  # disabled
