# Grasshopper definition GHforJulia.gh (Grasshopper 1.0.7)

panel = Panel("785")
websocket_client_start = WebsocketClientStart(Address="ws://127.0.0.1:2000/", InitalMessage=Slider(0.53, range=0..1), Reset=Toggle(True))
websocket_client_receiver = WebsocketClientReceiver(WebsocketObjects=websocket_client_start, AutoUpdate=Toggle(True))  # -> Message, Status
panel_2 = Panel(websocket_client_receiver.Message)
