# Grasshopper definition getCrossSectionData.gh (Grasshopper 1.0.7)

diameter_inch = Slider(0.25, range=0..1)

eps = Panel("200000")
ec = Panel("36406.04345434972")
division = Division(A=eps, B=ec)
panel = Panel(division)

yz = YZPlane(Origin=Point(0, 0, 0))

number_slider = Slider(5, range=0..10)
number_slider_2 = Slider(10, range=0..10)
pt = ConstructPoint(XCoordinate=number_slider, YCoordinate=number_slider_2, ZCoordinate=0)
expression = Expression(b=number_slider, h=number_slider_2, Expression="b*h^3/12")
expression_2 = Expression(b=number_slider_2, h=number_slider, Expression="b*h^3/12")
rec_2pt = Rectangle2Pt(Plane=PlaneXY(0, 0, 0), PointA=Point(0, 0, 0), PointB=pt, Radius=0)  # -> Rectangle, Length
iy = Panel(expression_2)
ix = Panel(expression)

panel_2 = Panel("70000")
# Input geometry of the pixel section
geo = Geometry([<brep referenced from the Rhino model> x3])
multiplication = Multiplication(A=diameter_inch, B="25.4")
division_2 = Division(A=multiplication, B="2")
amoments = AreaMoments(Geometry=geo)  # -> Area, Centroid, Inertia, InertiaError, Secondary, SecondaryError, Gyration
explode = Explode(Curve=geo, Recursive=True)  # -> Segments, flatten(Vertices)
pdecon = Deconstruct(Point=explode.Vertices)  # -> XComponent, YComponent, ZComponent
ma = MassAddition(Input=amoments.Area)  # -> Result, PartialResults
total_concrete_area_mm2 = Panel(ma.Result)
pdecon_2 = Deconstruct(Point=amoments.Inertia)  # -> XComponent, YComponent, ZComponent
sort = SortList(Keys=pdecon.ZComponent)  # -> Keys, ValuesA
item = ListItem(List=sort.Keys, Index=0, Wrap=True)
avr = Average(Input=amoments.Centroid)
pdecon_3 = Deconstruct(Point=avr)  # -> XComponent, YComponent, ZComponent
subtraction = Subtraction(A=pdecon_3.ZComponent, B=Slider(230, range=0..300))
pt_2 = ConstructPoint(XCoordinate=pdecon_3.XComponent, YCoordinate=pdecon_3.YComponent, ZCoordinate=subtraction)
steel_centroid = Point(pt_2)
number_slider_3 = Slider(6.53, range=0..10)
pdecon_4 = Deconstruct(Point=steel_centroid)  # -> XComponent, YComponent, ZComponent
subtraction_2 = Subtraction(A=pdecon_4.YComponent, B=number_slider_3)
addition = Addition(A=pdecon_4.YComponent, B=number_slider_3)
pt_3 = ConstructPoint(XCoordinate=pdecon_4.XComponent, YCoordinate=[addition, subtraction_2], ZCoordinate=pdecon_4.ZComponent)
circle = CircleCNR(Center=pt_3, Normal=yz, Radius=division_2)
amoments_2 = AreaMoments(Geometry=circle)  # -> Area, Centroid, Inertia, InertiaError, Secondary, SecondaryError, Gyration
ma_2 = MassAddition(Input=amoments_2.Area)  # -> Result, PartialResults
total_area_mm2 = Panel(ma_2.Result)
multiplication_2 = Multiplication(A=amoments_2.Area, B=division)
pdecon_5 = Deconstruct(Point=amoments_2.Inertia)  # -> XComponent, YComponent, ZComponent
transformed_area = Number(multiplication_2)
transformed_area_mm2 = Panel(transformed_area)
pdecon_6 = Deconstruct(Point=amoments_2.Centroid)  # -> XComponent, YComponent, ZComponent
ma_3 = MassAddition(Input=transformed_area)  # -> Result, PartialResults
total_transformed_steel_area_mm2 = Panel(ma_3.Result)
item_2 = ListItem(List=pdecon_6.ZComponent, Index=0, Wrap=True)
expression_3 = Expression(Ac=ma.Result, Ast_tr=ma_3.Result, zc=pdecon_3.ZComponent, zst=item_2, Expression="(Ac*zc + Ast_tr*zst) / (Ac + Ast_tr)")
pt_4 = ConstructPoint(XCoordinate=pdecon_3.XComponent, YCoordinate=pdecon_3.YComponent, ZCoordinate=expression_3)
subtraction_3 = Subtraction(A=pdecon_3.ZComponent, B=expression_3)
section_centroid = Point(pt_4)
dist = Distance(PointA=section_centroid, PointB=amoments_2.Centroid)
sqr = Square(Value=dist)
multiplication_3 = Multiplication(A=transformed_area, B=sqr)
pdecon_7 = Deconstruct(Point=section_centroid)  # -> XComponent, YComponent, ZComponent
addition_2 = Addition(A=multiplication_3, B=pdecon_5.YComponent)
subtraction_4 = Subtraction(A=pdecon_7.ZComponent, B=item)
ma_4 = MassAddition(Input=addition_2)  # -> Result, PartialResults
moment_of_inertia_of_wire_rope = Panel(ma_4.Result)
c = Number(subtraction_4)
c_mm = Panel(c)
dist_2 = Distance(PointA=section_centroid, PointB=amoments.Centroid)
sqr_2 = Square(Value=dist_2)
multiplication_4 = Multiplication(A=amoments.Area, B=sqr_2)
panel_3 = Panel(subtraction_3)
addition_3 = Addition(A=multiplication_4, B=pdecon_2.YComponent)
dist_3 = Distance(PointA=steel_centroid, PointB=section_centroid)
mid_eccentricity = Panel(dist_3)
ma_5 = MassAddition(Input=addition_3)  # -> Result, PartialResults
panel_4 = Panel(ma_5.Result)
addition_4 = Addition(A=ma_5.Result, B=ma_4.Result)
moment_of_inertia_of_the_transformed_sec = Panel(addition_4)  # "Moment of inertia of the transformed section"
