# Grasshopper definition getCroxData.gh (Grasshopper 1.0.7)
# plug-ins: SectionTools

rec_2pt = Rectangle2Pt(Plane=PlaneXY(0, 0, 0), PointA=Point(0, 0, 0), PointB=Point(10, 5, 0), Radius=0)  # -> Rectangle, Length
Y = UnitY(Factor=Slider(4, range=0..100))
X = UnitX(Factor=Slider(19, range=0..100))
move = Move(Geometry=rec_2pt.Rectangle, Motion=[X, Y])  # -> Geometry, Transform
geo = Geometry([rec_2pt.Rectangle, move.Geometry])
secprops = SectionProperties(Sections=rec_2pt.Rectangle)  # -> Area, Centroid, Moments
Y_2 = UnitY(Factor=1)
geo_2 = Geometry([<brep referenced from the Rhino model> x3])
number_slider = Slider(150, range=0..250)
diameter_inch = Slider(0.25, range=0..1)
division = Division(A=Slider(18000, range=0..100000), B=number_slider)
number_slider_2 = Slider(69, range=0..1000)
panel = Panel("70000")
pt = ConstructPoint(XCoordinate=0, YCoordinate=0, ZCoordinate=0)

eps = Panel("200000")
ec = Panel("36406.04345434972")
division_2 = Division(A=eps, B=ec)
panel_2 = Panel(division_2)

yz = YZPlane(Origin=Point(0, 0, 0))

number_slider_3 = Slider(5, range=0..10)
number_slider_4 = Slider(10, range=0..10)
pt_2 = ConstructPoint(XCoordinate=number_slider_3, YCoordinate=number_slider_4, ZCoordinate=0)
expression = Expression(b=number_slider_3, h=number_slider_4, Expression="b*h^3/12")
expression_2 = Expression(b=number_slider_4, h=number_slider_3, Expression="b*h^3/12")
rec_2pt_2 = Rectangle2Pt(Plane=PlaneXY(0, 0, 0), PointA=Point(0, 0, 0), PointB=pt_2, Radius=0)  # -> Rectangle, Length
iy = Panel(expression_2)
ix = Panel(expression)

panel_3 = Panel("500")
panel_4 = Panel(division)
# From Section 2 of the paper,
# it shows that the transformed moment of inertia does not include the post tension wire ropes.
# Input geometry of the pixel section
secprops_2 = SectionProperties(Sections=geo_2)  # -> Area, Centroid, Moments
rot3d = Rotate3D(Geometry=geo_2, Angle=1.570796327, Center=secprops_2.Centroid, Axis=Y_2)  # -> Geometry, Transform
rotate = Rotate(Geometry=rot3d.Geometry, Angle=1.570796327, Plane=secprops_2.Centroid)  # -> Geometry, Transform
item = ListItem(List=rotate.Geometry, Index=0, Wrap=True)
explode = Explode(Curve=item, Recursive=True)  # -> Segments, Vertices
join = JoinCurves(Curves=flatten(explode.Segments), Preserve=False)
vec2pt = Vector2Pt(PointA=secprops_2.Centroid, PointB=pt, Unitize=False)  # -> Vector, Length
multiplication = Multiplication(A=diameter_inch, B="25.4")
move_2 = Move(Geometry=rotate.Geometry, Motion=vec2pt.Vector)  # -> Geometry, Transform
geo_3 = Geometry(move_2.Geometry)
series = Series(Start=0, Step=division, Count=number_slider)
merge = Merge()
pt_3 = Point(secprops_2.Centroid)
division_3 = Division(A=multiplication, B="2")
cfroma = CompressionDepth(Sections=geo_3, TargetArea=series, Tolerance=0.01, Plane=0, MaxIterations=Slider(1000, range=0..1000))  # -> flatten(Depth), Error
amoments = AreaMoments(Geometry=geo_2)  # -> Area, Centroid, Inertia, InertiaError, Secondary, SecondaryError, Gyration
pt_4 = ConstructPoint(XCoordinate=series, YCoordinate=cfroma.Depth, ZCoordinate=cfroma.Error)
afromc = CompressionArea(Sections=geo_3, Depth=cfroma.Depth, Tolerance=0.001, Plane=0)  # -> Area, CompressionGeo
ma = MassAddition(Input=amoments.Area)  # -> Result, PartialResults
total_concrete_area_mm2 = Panel(ma.Result)
pdecon = Deconstruct(Point=amoments.Inertia)  # -> XComponent, YComponent, ZComponent
panel_5 = Panel(cfroma.Error)
panel_6 = Panel(pt_4)
geo_4 = Geometry(afromc.CompressionGeo)
panel_7 = Panel(cfroma.Depth)
avr = Average(Input=amoments.Centroid)
pdecon_2 = Deconstruct(Point=avr)  # -> XComponent, YComponent, ZComponent
subtraction = Subtraction(A=pdecon_2.ZComponent, B=Slider(230, range=0..300))
pt_5 = ConstructPoint(XCoordinate=pdecon_2.XComponent, YCoordinate=pdecon_2.YComponent, ZCoordinate=subtraction)
steel_centroid = Point(pt_5)
number_slider_5 = Slider(6.53, range=0..10)
dist = Distance(PointA=avr, PointB=steel_centroid)
pdecon_3 = Deconstruct(Point=steel_centroid)  # -> XComponent, YComponent, ZComponent
subtraction_2 = Subtraction(A=pdecon_3.YComponent, B=number_slider_5)
addition = Addition(A=pdecon_3.YComponent, B=number_slider_5)
c = Number(dist)
pt_6 = ConstructPoint(XCoordinate=pdecon_3.XComponent, YCoordinate=[addition, subtraction_2], ZCoordinate=pdecon_3.ZComponent)
circle = CircleCNR(Center=pt_6, Normal=yz, Radius=division_3)
amoments_2 = AreaMoments(Geometry=circle)  # -> Area, Centroid, Inertia, InertiaError, Secondary, SecondaryError, Gyration
ma_2 = MassAddition(Input=amoments_2.Area)  # -> Result, PartialResults
total_area_mm2 = Panel(ma_2.Result)
multiplication_2 = Multiplication(A=amoments_2.Area, B=division_2)
pdecon_4 = Deconstruct(Point=amoments_2.Inertia)  # -> XComponent, YComponent, ZComponent
transformed_area = Number(multiplication_2)
transformed_area_mm2 = Panel(transformed_area)
pdecon_5 = Deconstruct(Point=amoments_2.Centroid)  # -> XComponent, YComponent, ZComponent
ma_3 = MassAddition(Input=transformed_area)  # -> Result, PartialResults
total_transformed_steel_area_mm2 = Panel(ma_3.Result)
item_2 = ListItem(List=pdecon_5.ZComponent, Index=0, Wrap=True)
expression_3 = Expression(Ac=ma.Result, Ast_tr=ma_3.Result, zc=pdecon_2.ZComponent, zst=item_2, Expression="(Ac*zc + Ast_tr*zst) / (Ac + Ast_tr)")
c_2 = Panel(c)
pt_7 = ConstructPoint(XCoordinate=pdecon_2.XComponent, YCoordinate=pdecon_2.YComponent, ZCoordinate=expression_3)
section_centroid = Point(pt_7)
dist_2 = Distance(PointA=section_centroid, PointB=amoments_2.Centroid)
sqr = Square(Value=dist_2)
dist_3 = Distance(PointA=section_centroid, PointB=amoments.Centroid)
sqr_2 = Square(Value=dist_3)
multiplication_3 = Multiplication(A=transformed_area, B=sqr)
multiplication_4 = Multiplication(A=amoments.Area, B=sqr_2)
addition_2 = Addition(A=multiplication_3, B=pdecon_4.YComponent)
addition_3 = Addition(A=multiplication_4, B=pdecon.YComponent)
ma_4 = MassAddition(Input=addition_2)  # -> Result, PartialResults
panel_8 = Panel(ma_4.Result)
ma_5 = MassAddition(Input=addition_3)  # -> Result, PartialResults
panel_9 = Panel(ma_5.Result)
addition_4 = Addition(A=ma_5.Result, B=ma_4.Result)
panel_10 = Panel(addition_4)
