# Grasshopper definition getCvsIc.gh (Grasshopper 1.0.7)
# plug-ins: SectionTools

rec_2pt = Rectangle2Pt(Plane=PlaneXY(0, 0, 0), PointA=Point(0, 0, 0), PointB=Point(10, 5, 0), Radius=0)  # -> Rectangle, Length
Y = UnitY(Factor=Slider(4, range=0..100))
X = UnitX(Factor=Slider(19, range=0..100))

geo = Geometry([<brep referenced from the Rhino model> x3])
Y_2 = UnitY(Factor=1)
secprops = SectionProperties(Sections=geo)  # -> Area, Centroid, Moments
rot3d = Rotate3D(Geometry=geo, Angle=1.570796327, Center=secprops.Centroid, Axis=Y_2)  # -> Geometry, Transform
pt = ConstructPoint(XCoordinate=0, YCoordinate=0, ZCoordinate=0)
# From Section 2 of the paper,
# it shows that the transformed moment of inertia does not include the post tension wire ropes.
rotate = Rotate(Geometry=rot3d.Geometry, Angle=1.570796327, Plane=secprops.Centroid)  # -> Geometry, Transform
vec2pt = Vector2Pt(PointA=secprops.Centroid, PointB=pt, Unitize=False)  # -> Vector, Length
# Input geometry of the pixel section
move = Move(Geometry=rotate.Geometry, Motion=vec2pt.Vector)  # -> Geometry, Transform

move_2 = Move(Geometry=rec_2pt.Rectangle, Motion=[X, Y])  # -> Geometry, Transform
geo_2 = Geometry([rec_2pt.Rectangle, move_2.Geometry])
secprops_2 = SectionProperties(Sections=rec_2pt.Rectangle)  # -> Area, Centroid, Moments
number_slider = Slider(150, range=0..250)
diameter_inch = Slider(0.25, range=0..1)
division = Division(A=Slider(18000, range=0..100000), B=number_slider)
panel = Panel("70000")

eps = Panel("200000")
ec = Panel("36406.04345434972")
division_2 = Division(A=eps, B=ec)
panel_2 = Panel(division_2)

yz = YZPlane(Origin=Point(0, 0, 0))

number_slider_2 = Slider(5, range=0..10)
number_slider_3 = Slider(10, range=0..10)
pt_2 = ConstructPoint(XCoordinate=number_slider_2, YCoordinate=number_slider_3, ZCoordinate=0)
expression = Expression(b=number_slider_2, h=number_slider_3, Expression="b*h^3/12")
expression_2 = Expression(b=number_slider_3, h=number_slider_2, Expression="b*h^3/12")
rec_2pt_2 = Rectangle2Pt(Plane=PlaneXY(0, 0, 0), PointA=Point(0, 0, 0), PointB=pt_2, Radius=0)  # -> Rectangle, Length
iy = Panel(expression_2)
ix = Panel(expression)

panel_3 = Panel("500")
panel_4 = Panel(division)
multiplication = Multiplication(A=diameter_inch, B="25.4")
geo_3 = Geometry(move.Geometry)
series = Series(Start=0, Step=division, Count=number_slider)
merge = Merge()
division_3 = Division(A=multiplication, B="2")
explode = Explode(Curve=geo_3, Recursive=True)  # -> Segments, flatten(Vertices)
cfroma = CompressionDepth(Sections=geo_3, TargetArea=series, Tolerance=0.01, Plane=0, MaxIterations=Slider(1000, range=0..1000))  # -> flatten(Depth), Error; disabled
pdecon = Deconstruct(Point=explode.Vertices)  # -> XComponent, YComponent, ZComponent
sort = SortList(Keys=pdecon.XComponent, ValuesA=explode.Vertices)  # -> Keys, ValuesA
sort_2 = SortList(Keys=pdecon.YComponent, ValuesA=explode.Vertices)  # -> Keys, ValuesA
number_slider_4 = Slider(131, range=0..300)
item = ListItem(List=sort_2.ValuesA, Index=0, Wrap=True)  # -> Item1, Item
item_2 = ListItem(List=sort.ValuesA, Index=0, Wrap=True)
series_2 = Series(Start=0, Step=1, Count=Slider(230, range=0..1000))
circle = CircleCNR(Normal=yz, Radius=division_3)
pdecon_2 = Deconstruct(Point=item.Item1)  # -> XComponent, YComponent, ZComponent
pdecon_3 = Deconstruct(Point=item_2)  # -> XComponent, YComponent, ZComponent
num = Number(series_2)
pt_3 = ConstructPoint(XCoordinate=series, YCoordinate=cfroma.Depth, ZCoordinate=cfroma.Error)
amoments = AreaMoments(Geometry=circle)  # -> Area, Centroid, Inertia, InertiaError, Secondary, SecondaryError, Gyration
afromc = CompressionArea(Sections=geo_3, Depth=cfroma.Depth, Tolerance=0.001, Plane=0)  # -> Area, CompressionGeo
panel_5 = Panel(cfroma.Error)
subtraction = Subtraction(A=pdecon_2.YComponent, B=num)
ma = MassAddition(Input=amoments.Area)  # -> Result, PartialResults
panel_6 = Panel(pt_3)
pt_4 = ConstructPoint(XCoordinate=expr("-x", pdecon_3.XComponent), YCoordinate=pdecon_2.YComponent, ZCoordinate=pdecon_2.ZComponent)
pt_5 = ConstructPoint(XCoordinate=pdecon_3.XComponent, YCoordinate=subtraction, ZCoordinate=pdecon_2.ZComponent)
total_area_mm2 = Panel(ma.Result)
multiplication_2 = Multiplication(A=amoments.Area, B=division_2)
geo_4 = Geometry(afromc.CompressionGeo)
panel_7 = Panel(cfroma.Depth)
rec_2pt_3 = Rectangle2Pt(Plane=PlaneXY(0, 0, 0), PointA=pt_5, PointB=pt_4, Radius=0)  # -> Rectangle, Length
pdecon_4 = Deconstruct(Point=amoments.Inertia)  # -> XComponent, YComponent, ZComponent
transformed_area = Number(multiplication_2)
transformed_area_mm2 = Panel(transformed_area)
pdecon_5 = Deconstruct(Point=amoments.Centroid)  # -> XComponent, YComponent, ZComponent
boundary = BoundarySurfaces(Edges=graft(rec_2pt_3.Rectangle))
item_3 = ListItem(List=geo_3, Index=0, Wrap=True)  # -> Item, Item1, Item2
rint = RegionIntersection(CurvesA=boundary, CurvesB=item_3.Item)
rint_2 = RegionIntersection(CurvesA=boundary, CurvesB=item_3.Item1)
rint_3 = RegionIntersection(CurvesA=boundary, CurvesB=item_3.Item2)
ma_2 = MassAddition(Input=transformed_area)  # -> Result, PartialResults
total_transformed_steel_area_mm2 = Panel(ma_2.Result)
item_4 = ListItem(List=pdecon_5.ZComponent, Index=0, Wrap=True)
cut_geo = Geometry([rint, rint_2, rint_3])
amoments_2 = AreaMoments(Geometry=cut_geo)  # -> Area, Centroid, Inertia, InertiaError, Secondary, SecondaryError, Gyration
pdecon_6 = Deconstruct(Point=amoments_2.Inertia)  # -> XComponent, YComponent, ZComponent
ma_3 = MassAddition(Input=amoments_2.Area)  # -> Result, PartialResults
pdecon_7 = Deconstruct(Point=amoments_2.Centroid)  # -> XComponent, YComponent, ZComponent
multiplication_3 = Multiplication(A=amoments_2.Area, B=amoments_2.Centroid)
y_pos = Number(pdecon_7.YComponent)
ma_4 = MassAddition(Input=multiplication_3)  # -> Result, PartialResults
total_concrete_area_mm2 = Panel(ma_3.Result)
division_4 = Division(A=ma_4.Result, B=ma_3.Result)
avr = Average(Input=amoments_2.Centroid)
pdecon_8 = Deconstruct(Point=division_4)  # -> XComponent, YComponent, ZComponent
subtraction_2 = Subtraction(A=pdecon_8.YComponent, B=y_pos)
sqr = Square(Value=subtraction_2)
dist = Distance(PointA=avr, PointB=amoments_2.Centroid)
multiplication_4 = Multiplication(A=sqr, B=amoments_2.Area)
pdecon_9 = Deconstruct(Point=avr)  # -> XComponent, YComponent, ZComponent
addition = Addition(A=multiplication_4, B=pdecon_6.YComponent)
sqr_2 = Square(Value=dist)
subtraction_3 = Subtraction(A=pdecon_9.ZComponent, B=Slider(133, range=0..300))
multiplication_5 = Multiplication(A=amoments_2.Area, B=sqr_2)
ma_5 = MassAddition(Input=addition)  # -> Result, PartialResults
addition_2 = Addition(A=multiplication_5, B=pdecon_6.YComponent)
expression_3 = Expression(
    Ac=ma_3.Result,
    Ast_tr=ma_2.Result,
    zc=pdecon_9.ZComponent,
    zst=item_4,
    Expression="(Ac*zc + Ast_tr*zst) / (Ac + Ast_tr)")
panel_8 = Panel(ma_5.Result)
ma_6 = MassAddition(Input=addition_2)  # -> Result, PartialResults
subtraction_4 = Subtraction()
panel_9 = Panel(ma_6.Result)
pt_6 = ConstructPoint(XCoordinate=pdecon_9.XComponent, YCoordinate=pdecon_9.YComponent, ZCoordinate=expression_3)
section_centroid = Point(pt_6)
dist_2 = Distance(PointA=section_centroid, PointB=amoments.Centroid)
sqr_3 = Square(Value=dist_2)
multiplication_6 = Multiplication(A=transformed_area, B=sqr_3)
addition_3 = Addition(A=multiplication_6, B=pdecon_4.YComponent)
ma_7 = MassAddition(Input=addition_3)  # -> Result, PartialResults
panel_10 = Panel(ma_7.Result)
addition_4 = Addition(A=ma_6.Result, B=ma_7.Result)
panel_11 = Panel(addition_4)
